# Grasshopper definition carcara_winsetup_rev06.gh (Grasshopper 1.0.8)

# ----
# 01. INSTALL DRIVER ODBC
catches = BooleanToggle(False)
driver_odbc_installer = Python3Script(install_driver=catches)  # -> out
# ---------- driver_odbc_installer: Python ----------
# PostgreSQL ODBC Driver Installer - Grasshopper Component (Download & Launch)
# Version: 2.1.2 (2025-10-22)
# Purpose:
# - Download the official PostgreSQL ODBC driver installer (standard version).
# - Launch the installer for the user to complete setup interactively.
#
# Inputs:
#   install_driver (bool): Trigger download and launch when True.
#
# Outputs:
#   out (str): Status messages from download and launch operations.

import os
import threading
import urllib.request

from Grasshopper.Kernel import GH_RuntimeMessageLevel as RML

try:
    from Eto.Forms import Application
except Exception:
    Application = None

# ------------------------------------------------------------------------------
# Configuration
# ------------------------------------------------------------------------------
INSTALLER_URL = "https://ftp.postgresql.org/pub/odbc/releases/REL-17_00_0006/psqlodbc-setup.exe"
INSTALLER_FILENAME = "psqlodbc-setup.exe"

# Global message log
messages = []

# ------------------------------------------------------------------------------
# Utilities
# ------------------------------------------------------------------------------
def report(level, message):
    """Post a runtime message to Grasshopper and console, and log it."""
    try:
        ghenv.Component.AddRuntimeMessage(level, message)
    except:
        pass
    print(message)
    messages.append(message)

def ui_invoke(func):
    """Invoke a callable on the UI thread when available."""
    if Application is not None and Application.Instance is not None:
        try:
            Application.Instance.Invoke(func)
            return
        except Exception:
            pass
    func()

def get_downloads_folder():
    """Return the user's Downloads directory."""
    if os.name == 'nt':
        return os.path.join(os.environ.get('USERPROFILE', ''), 'Downloads')
    return os.path.join(os.environ.get('HOME', ''), 'Downloads')

def download_file(url, output_path):
    """Download a file to a path with error handling."""
    try:
        ui_invoke(lambda: report(RML.Remark, "Downloading installer from: {}".format(url)))
        urllib.request.urlretrieve(url, output_path)
        sz = os.path.getsize(output_path)
        ui_invoke(lambda: report(RML.Remark, "Downloaded {} ({:.2f} MB)".format(output_path, sz / (1024.0 * 1024.0))))
        return True
    except Exception as ex:
        error_msg = "Download error: {}".format(ex)
        ui_invoke(lambda msg=error_msg: report(RML.Error, msg))
        return False

def launch_installer(installer_path):
    """Launch the installer using the default application handler."""
    try:
        if not os.path.exists(installer_path):
            ui_invoke(lambda: report(RML.Error, "Installer file not found: {}".format(installer_path)))
            return False
        
        ui_invoke(lambda: report(RML.Warning, "Launching installer. Follow the on-screen instructions to complete installation."))
        
        if os.name == 'nt':
            os.startfile(installer_path)
        else:
            import subprocess
            subprocess.Popen(['open', installer_path])
        
        ui_invoke(lambda: report(RML.Remark, "Installer launched successfully."))
        return True
    except Exception as ex:
        error_msg = "Failed to launch installer: {}".format(ex)
        ui_invoke(lambda msg=error_msg: report(RML.Error, msg))
        return False

# ------------------------------------------------------------------------------
# Async worker
# ------------------------------------------------------------------------------
def download_and_launch_worker(url, installer_path):
    """Background worker to download and launch installer without blocking UI."""
    if download_file(url, installer_path):
        launch_installer(installer_path)

# ------------------------------------------------------------------------------
# Main execution
# ------------------------------------------------------------------------------
install_driver = globals().get('install_driver', False)
if not isinstance(install_driver, bool):
    install_driver = False

out = ""

try:
    if not install_driver:
        out = "Set 'install_driver' to True to download and launch the PostgreSQL ODBC installer."
        report(RML.Remark, out)
    else:
        downloads_folder = get_downloads_folder()
        installer_path = os.path.join(downloads_folder, INSTALLER_FILENAME)
        
        report(RML.Remark, "Starting download process...")
        report(RML.Remark, "Target location: {}".format(downloads_folder))
        
        t = threading.Thread(target=download_and_launch_worker, args=(INSTALLER_URL, installer_path))
        t.daemon = True
        t.start()
        
        out = "Download initiated. Check runtime messages for progress."

except Exception as ex:
    error_msg = "Unexpected error: {}".format(ex)
    report(RML.Error, error_msg)
    out = error_msg

# Combine all messages into out
if messages:
    out = "\n".join(messages)

ghenv.Component.Message = "v2.1.2"
# ---------- end driver_odbc_installer ----------
panel = Panel(driver_odbc_installer)

# ----
# 02. INSTALL CARCARÁ
kills = BooleanToggle(False)
install_carcará_clusters = Python3Script(install=kills)  # -> out
# ---------- install_carcará_clusters: Python ----------
"""Carcara Library Installer - Grasshopper Component

This component automates the download and installation of the Carcara library
from GitHub. Includes backup, version checking, and user confirmation for
reinstallation when already up-to-date.

Important: This component modifies Grasshopper UserObjects folder.
A backup is automatically created before any changes.

Args (Component Inputs):
    install (bool): Trigger installation/update
        - Type: bool
        - Access: item
        - Optional: No
        - Note: Uses edge detection (only runs on False->True transition)

Returns (Component Outputs):
    out (str): Installation status and messages
    installed_version (str): Currently installed version
    available_version (str): Latest version from GitHub

Version: 1.2.1
Date: 2025/10/30
Requires: urllib, zipfile, shutil, System.Windows.Forms
"""

import os
import shutil
import zipfile
import urllib.request
from datetime import datetime
import System.Windows.Forms as WF
from Grasshopper.Kernel import GH_RuntimeMessageLevel as RML


#################
# CONFIGURATION #
#################

GITHUB_REPO = "led-ufc/carcara"
GITHUB_ZIP_URL = "https://github.com/{}/archive/refs/heads/master.zip".format(GITHUB_REPO)
GITHUB_VERSION_URL = "https://raw.githubusercontent.com/{}/master/carcara/version.txt".format(GITHUB_REPO)

USER_OBJECTS_FOLDER = os.path.join(os.environ.get("APPDATA", ""), "Grasshopper", "UserObjects")
TARGET_FOLDER = os.path.join(USER_OBJECTS_FOLDER, "carcara")
DOWNLOADS_FOLDER = os.path.join(os.path.expanduser("~"), "Downloads")
VERSION_FILE = "version.txt"


#####################################
# PERSISTENT STATE (EDGE DETECTION) #
#####################################

try:
    prev_install
except NameError:
    prev_install = False


####################
# HELPER FUNCTIONS #
####################

def report(level, message):
    """Send runtime message to Grasshopper component."""
    ghenv.Component.AddRuntimeMessage(level, message)
    print(message)


def get_installed_version():
    """Get currently installed Carcara version."""
    version_path = os.path.join(TARGET_FOLDER, VERSION_FILE)
    if os.path.exists(version_path):
        try:
            with open(version_path, 'r') as f:
                version = f.read().strip()
                return version
        except Exception as e:
            report(RML.Warning, "Could not read version file: {}".format(e))
    return None


def get_available_version():
    """Get latest Carcara version from GitHub."""
    try:
        response = urllib.request.urlopen(GITHUB_VERSION_URL, timeout=10)
        version = response.read().decode('utf-8').strip()
        return version
    except urllib.error.HTTPError as e:
        if e.code == 404:
            report(RML.Remark, "version.txt not found in repository")
            return "Unknown"
        else:
            report(RML.Warning, "HTTP error fetching version: {}".format(e))
            return None
    except Exception as e:
        report(RML.Warning, "Could not fetch remote version: {}".format(e))
        return None


def compare_versions(current, available):
    """Compare version strings."""
    if current is None:
        return -1
    if available is None or available == "Unknown":
        return None
    
    try:
        if current < available:
            return -1
        elif current > available:
            return 1
        else:
            return 0
    except:
        return None


def ask_user_confirmation(message, title="Confirm Installation"):
    """
    Show confirmation dialog to user.
    
    Args:
        message (str): Dialog message
        title (str): Dialog title
    
    Returns:
        bool: True if user clicked Yes
    """
    response = WF.MessageBox.Show(
        message,
        title,
        WF.MessageBoxButtons.YesNo,
        WF.MessageBoxIcon.Question
    )
    return response == WF.DialogResult.Yes


def check_if_should_proceed(installed_version, available_version):
    """
    Determine if installation should proceed based on versions.
    Shows appropriate dialogs for different scenarios.
    
    Returns:
        tuple: (should_proceed: bool, reason: str)
    """
    comparison = compare_versions(installed_version, available_version)
    
    if installed_version is None:
        return True, "Installing Carcara for the first time"
    
    if comparison is None:
        message = (
            "Cannot verify remote version.\n\n"
            "Current version: {}\n\n"
            "Proceed with installation anyway?"
        ).format(installed_version)
        
        if ask_user_confirmation(message, "Version Check Failed"):
            return True, "User chose to proceed despite version check failure"
        else:
            return False, "User cancelled installation"
    
    if comparison == -1:
        message = (
            "An update is available!\n\n"
            "Installed version: {}\n"
            "Available version: {}\n\n"
            "Update now?"
        ).format(installed_version, available_version)
        
        if ask_user_confirmation(message, "Update Available"):
            return True, "Updating from {} to {}".format(installed_version, available_version)
        else:
            return False, "User cancelled update"
    
    elif comparison == 0:
        message = (
            "Carcara {} is already up to date.\n\n"
            "Do you want to reinstall anyway?\n\n"
            "(This can help repair corrupted installations)"
        ).format(installed_version)
        
        if ask_user_confirmation(message, "Already Up-to-Date"):
            return True, "Reinstalling version {} (user confirmed)".format(installed_version)
        else:
            return False, "Installation skipped - already up to date"
    
    elif comparison == 1:
        message = (
            "Your installed version is NEWER than available!\n\n"
            "Installed version: {}\n"
            "Available version: {}\n\n"
            "Do you want to DOWNGRADE?"
        ).format(installed_version, available_version)
        
        if ask_user_confirmation(message, "Downgrade Warning"):
            return True, "Downgrading from {} to {} (user confirmed)".format(installed_version, available_version)
        else:
            return False, "User cancelled downgrade"
    
    return False, "Unknown version comparison result"


def download_file(url, output_path):
    """Download file with progress indication."""
    try:
        report(RML.Remark, "Downloading from: {}".format(url))
        urllib.request.urlretrieve(url, output_path)
        
        file_size = os.path.getsize(output_path)
        return True, "Downloaded successfully ({:.2f} MB)".format(file_size / (1024 * 1024))
    except Exception as e:
        return False, "Download error: {}".format(e)


def extract_zip(zip_path, extraction_folder):
    """Extract ZIP file."""
    try:
        os.makedirs(extraction_folder, exist_ok=True)
        with zipfile.ZipFile(zip_path, 'r') as zip_ref:
            zip_ref.extractall(extraction_folder)
        return True, "Extracted successfully"
    except Exception as e:
        return False, "Extraction error: {}".format(e)


def backup_folder_as_zip(target_folder):
    """Create timestamped ZIP backup of folder."""
    try:
        parent = os.path.dirname(target_folder)
        folder_name = os.path.basename(target_folder.rstrip("\\/"))
        timestamp = datetime.now().strftime("%Y%m%d-%H%M%S")
        base_name = os.path.join(parent, "{}-{}".format(folder_name, timestamp))
        
        archive_path = shutil.make_archive(
            base_name=base_name,
            format='zip',
            root_dir=parent,
            base_dir=folder_name
        )
        return True, archive_path, "Backup created: {}".format(archive_path)
    except Exception as e:
        return False, None, "Backup error: {}".format(e)


def rollback_from_backup(backup_path, target_folder):
    """Restore folder from backup ZIP."""
    try:
        if os.path.exists(target_folder):
            shutil.rmtree(target_folder)
        
        parent = os.path.dirname(target_folder)
        with zipfile.ZipFile(backup_path, 'r') as zip_ref:
            zip_ref.extractall(parent)
        
        report(RML.Warning, "Rollback successful from: {}".format(backup_path))
        return True
    except Exception as e:
        report(RML.Error, "Rollback failed: {}".format(e))
        return False


def replace_folder(source_folder, target_folder, backup_path=None):
    """Replace target folder with source, with rollback on failure."""
    try:
        if os.path.exists(target_folder):
            shutil.rmtree(target_folder)
        
        shutil.move(source_folder, target_folder)
        return True, "Installation successful"
    except Exception as e:
        error_msg = "Installation error: {}".format(e)
        
        if backup_path and os.path.exists(backup_path):
            report(RML.Warning, "Attempting rollback...")
            if rollback_from_backup(backup_path, target_folder):
                error_msg += " (Rollback successful)"
            else:
                error_msg += " (Rollback FAILED - manual intervention needed!)"
        
        return False, error_msg


def cleanup_files(*paths):
    """Remove temporary files and folders."""
    for path in paths:
        try:
            if os.path.exists(path):
                if os.path.isfile(path):
                    os.remove(path)
                else:
                    shutil.rmtree(path)
        except Exception as e:
            report(RML.Warning, "Cleanup warning for {}: {}".format(path, e))


def install_carcara():
    """Main installation function."""
    zip_filename = "carcara_master.zip"
    zip_path = os.path.join(DOWNLOADS_FOLDER, zip_filename)
    temp_extract_folder = os.path.join(DOWNLOADS_FOLDER, "temp_carcara_extract")
    backup_path = None
    
    try:
        success, message = download_file(GITHUB_ZIP_URL, zip_path)
        if not success:
            return message
        report(RML.Remark, message)
        
        success, message = extract_zip(zip_path, temp_extract_folder)
        if not success:
            cleanup_files(zip_path)
            return message
        report(RML.Remark, message)
        
        extracted_repo_folder = os.path.join(temp_extract_folder, "carcara-master")
        source_folder = os.path.join(extracted_repo_folder, "carcara")
        
        if not os.path.exists(source_folder):
            cleanup_files(zip_path, temp_extract_folder)
            return "Error: 'carcara' folder not found in repository"
        
        if os.path.exists(TARGET_FOLDER):
            success, backup_path, message = backup_folder_as_zip(TARGET_FOLDER)
            if not success:
                cleanup_files(zip_path, temp_extract_folder)
                return message
            report(RML.Remark, message)
        
        success, message = replace_folder(source_folder, TARGET_FOLDER, backup_path)
        if not success:
            cleanup_files(zip_path, temp_extract_folder)
            return message
        
        cleanup_files(zip_path, temp_extract_folder)
        
        new_version = get_installed_version()
        if new_version:
            return "Carcara {} installed successfully".format(new_version)
        else:
            return "Carcara installed successfully"
    
    except Exception as e:
        return "Unexpected error: {}".format(e)


####################
# INPUT VALIDATION #
####################

install = globals().get('install', False)

if not isinstance(install, bool):
    install = False


##################
# MAIN EXECUTION #
##################

out = ""
installed_version = get_installed_version()
available_version = get_available_version()

if install and not prev_install:
    should_proceed, reason = check_if_should_proceed(installed_version, available_version)
    
    report(RML.Remark, reason)
    
    if should_proceed:
        out = install_carcara()
        installed_version = get_installed_version()
    else:
        out = reason
else:
    out = "Set 'install' to True to download and install Carcara library.\n\n"
    
    if installed_version:
        out += "Installed version: {}\n".format(installed_version)
    else:
        out += "Status: Not installed\n"
    
    if available_version and available_version != "Unknown":
        out += "Available version: {}\n".format(available_version)
    
    out += "\nSource: {}".format(GITHUB_REPO)
    
    report(RML.Remark, out)

prev_install = install


##########
# OUTPUT #
##########

ghenv.Component.Message = "v1.2.1"
# ---------- end install_carcará_clusters ----------
panel_2 = Panel(install_carcará_clusters)

# ----
# 03. INSTALL PYTHON LIBRARIES
and_eats = BooleanToggle(False)
install_python_libraries = Python3Script(install=and_eats)  # -> out
# ---------- install_python_libraries: Python ----------
"""Python Library Installer - Grasshopper Component (Rhino 8 Optimized)

This component installs Python libraries into Rhino 8's CPython environment.
Optimized specifically for Rhino 8 with simplified environment detection.

Important: This modifies Rhino 8's Python environment.
Requires internet connection and may take several minutes.

Args (Component Inputs):
    install (bool): Trigger library installation
        - Type: bool
        - Access: item
        - Optional: No

Returns (Component Outputs):
    out (str): Installation status and messages
    installed_libs (list): List of successfully installed libraries
    python_version (str): Detected Python version

Version: 1.2.1
Date: 2025/10/30
Requires: subprocess, sys
Rhino: 8+ only (CPython 3.9)
"""

import os
import sys
import subprocess
from Grasshopper.Kernel import GH_RuntimeMessageLevel as RML


#################
# CONFIGURATION #
#################

LIBRARIES = [
    'pyodbc',
    'shapely',
    'matplotlib',
    'numpy'
]

CREATE_NO_WINDOW = 0x08000000


#####################################
# PERSISTENT STATE (EDGE DETECTION) #
#####################################

try:
    prev_install
except NameError:
    prev_install = False


####################
# HELPER FUNCTIONS #
####################

def report(level, message):
    """Send runtime message to Grasshopper component."""
    ghenv.Component.AddRuntimeMessage(level, message)
    print(message)


def get_python_version():
    """
    Get Python version string.
    
    Returns:
        str: Python version (e.g., "3.9.10")
    """
    return "{}.{}.{}".format(
        sys.version_info[0],
        sys.version_info[1],
        sys.version_info[2]
    )


def get_pip_path():
    """
    Get path to pip executable in Rhino 8 CPython environment.
    Simplified for Rhino 8 - assumes .rhinocode/py39-rh8 structure.
    
    Returns:
        str: Path to pip.exe or None if not found
    """
    python_exe = sys.executable
    python_dir = os.path.dirname(python_exe)
    
    pip_path = os.path.join(python_dir, "Scripts", "pip.exe")
    
    if os.path.exists(pip_path):
        return pip_path
    
    username = os.environ.get('USERNAME') or os.environ.get('USER')
    if username:
        userprofile = os.environ.get('USERPROFILE') or os.path.join('C:\\Users', username)
        pip_path = os.path.join(
            userprofile,
            ".rhinocode",
            "py39-rh8",
            "Scripts",
            "pip.exe"
        )
        
        if os.path.exists(pip_path):
            return pip_path
    
    return None


def check_library_installed(library_name, pip_path):
    """
    Check if library is already installed.
    Uses CREATE_NO_WINDOW to prevent console window popup.
    
    Args:
        library_name (str): Name of the library
        pip_path (str): Path to pip executable
    
    Returns:
        tuple: (installed: bool, version: str or None)
    """
    try:
        result = subprocess.run(
            [pip_path, "show", library_name],
            capture_output=True,
            text=True,
            timeout=10,
            creationflags=CREATE_NO_WINDOW
        )
        
        if result.returncode == 0:
            for line in result.stdout.split('\n'):
                if line.startswith('Version:'):
                    version = line.split(':', 1)[1].strip()
                    return True, version
            return True, "Unknown"
        else:
            return False, None
    except Exception as e:
        report(RML.Warning, "Error checking {}: {}".format(library_name, e))
        return False, None


def install_library(library_name, pip_path):
    """
    Install a single library using pip.
    Uses CREATE_NO_WINDOW to prevent console window popup.
    
    Args:
        library_name (str): Name of the library to install
        pip_path (str): Path to pip executable
    
    Returns:
        tuple: (success: bool, message: str)
    """
    try:
        report(RML.Remark, "Installing {}...".format(library_name))
        
        result = subprocess.run(
            [pip_path, "install", library_name, "--no-warn-script-location"],
            capture_output=True,
            text=True,
            timeout=300,
            creationflags=CREATE_NO_WINDOW
        )
        
        if result.returncode == 0:
            return True, "Successfully installed {}".format(library_name)
        else:
            error_msg = result.stderr.strip() if result.stderr else result.stdout.strip()
            return False, "Failed to install {}: {}".format(library_name, error_msg)
    
    except subprocess.TimeoutExpired:
        return False, "Installation of {} timed out (>5 minutes)".format(library_name)
    except Exception as e:
        return False, "Error installing {}: {}".format(library_name, e)


def install_all_libraries(libraries, pip_path):
    """
    Install all libraries with progress reporting.
    
    Args:
        libraries (list): List of library names to install
        pip_path (str): Path to pip executable
    
    Returns:
        tuple: (results: dict, summary: str)
    """
    results = {
        'total': len(libraries),
        'installed': [],
        'already_installed': [],
        'failed': []
    }
    
    report(RML.Remark, "Checking {} libraries...".format(len(libraries)))
    
    for lib in libraries:
        is_installed, version = check_library_installed(lib, pip_path)
        
        if is_installed:
            report(
                RML.Remark,
                "{} already installed (v{})".format(lib, version or "unknown")
            )
            results['already_installed'].append((lib, version))
        else:
            success, message = install_library(lib, pip_path)
            report(RML.Remark, message)
            
            if success:
                results['installed'].append(lib)
            else:
                results['failed'].append((lib, message))
                report(RML.Error, message)
    
    summary_parts = []
    
    if results['installed']:
        summary_parts.append("Installed: {}".format(", ".join(results['installed'])))
    
    if results['already_installed']:
        libs = [lib for lib, ver in results['already_installed']]
        summary_parts.append("Already installed: {}".format(", ".join(libs)))
    
    if results['failed']:
        libs = [lib for lib, msg in results['failed']]
        summary_parts.append("Failed: {}".format(", ".join(libs)))
    
    summary = " | ".join(summary_parts) if summary_parts else "No changes"
    
    return results, summary


####################
# INPUT VALIDATION #
####################

install = globals().get('install', False)

if not isinstance(install, bool):
    install = False


##################
# MAIN EXECUTION #
##################

out = ""
installed_libs = []
python_version = get_python_version()

if sys.version_info < (3, 9):
    out = "ERROR: This component requires Rhino 8 with Python 3.9+\n"
    out += "Current: Python {}\n".format(python_version)
    out += "Please ensure you're using a Python 3 Script component in Rhino 8."
    report(RML.Error, out)
else:
    if install and not prev_install:
        pip_path = get_pip_path()
        
        if pip_path is None:
            out = "ERROR: pip.exe not found in Rhino 8 Python environment.\n"
            out += "Python {}: {}".format(python_version, sys.executable)
            report(RML.Error, "Cannot proceed without pip")
        else:
            report(RML.Remark, "Python {}: {}".format(python_version, sys.executable))
            report(RML.Remark, "Using pip: {}".format(pip_path))
            report(RML.Remark, "Starting installation process...")
            
            results, summary = install_all_libraries(LIBRARIES, pip_path)
            
            out = "Installation complete\n{}".format(summary)
            installed_libs = results['installed'] + [lib for lib, ver in results['already_installed']]
            
            if results['failed']:
                report(RML.Warning, "Some libraries failed to install")
                out += "\n\nRestart Rhino/Grasshopper to complete installation"
            else:
                report(RML.Remark, "All libraries ready")
                out += "\n\nAll libraries installed successfully"
                out += "\nRestart Rhino/Grasshopper to use new libraries"
    else:
        out = "Set 'install' to True to install Python libraries for Rhino 8.\n\n"
        out += "Target libraries: {}".format(", ".join(LIBRARIES))
        report(RML.Remark, out)

prev_install = install


##########
# OUTPUT #
##########

ghenv.Component.Message = "v1.2.1"
# ---------- end install_python_libraries ----------
panel_3 = Panel(install_python_libraries)

# ----
# general info
# The Carcará plugin is a set of user objects built using the power of the python 3 component. Access to databases is via the ODCB driver, which needs to be installed on the operating system (01).
# 
# The components are downloaded from the github repository (https://github.com/led-ufc/carcara) where their latest version is hosted. If you already have a previous installation, the procedure will ask you if you want to replace the existing files (02).
# 
# Finally, some libraries for python 3 are required, and these are automatically installed in rhino's python 3 environment (03.)
c_script = CSharpScript()  # -> filename
# ---------- c_script: C# ----------
// Grasshopper Script Instance
#region Usings
using System;
using System.Linq;
using System.Collections;
using System.Collections.Generic;
using System.Drawing;

using Rhino;
using Rhino.Geometry;

using Grasshopper;
using Grasshopper.Kernel;
using Grasshopper.Kernel.Data;
using Grasshopper.Kernel.Types;
#endregion

public class Script_Instance : GH_ScriptInstance
{
    #region Notes
    /* 
      Members:
        RhinoDoc RhinoDocument
        GH_Document GrasshopperDocument
        IGH_Component Component
        int Iteration

      Methods (Virtual & overridable):
        Print(string text)
        Print(string format, params object[] args)
        Reflect(object obj)
        Reflect(object obj, string method_name)
    */
    #endregion

    private void RunScript(ref object filename)
    {
        var filename_only = System.IO.Path.GetFileName(GrasshopperDocument.FilePath);
    filename = filename_only;
    }
}
# ---------- end c_script ----------
panel_4 = Panel(c_script)
